# Grasshopper definition poisson_circles.gh (Grasshopper 1.0.6)
# plug-ins: TT Toolbox

pt = Point([<point referenced from the Rhino model> x1805])
cullduppoints = RemoveDuplicatePoints(InputPoints=pt, Tolerance=0.1)  # -> OutputPoints, FirstPointIndexes
cps = ClosestPoints(Point=graft(cullduppoints.OutputPoints), Cloud=cullduppoints.OutputPoints, Count=2)  # -> ClosestPoint, CPIndex, Distance
circle = Circle()
cp = ClosestPoint(Point=graft(cullduppoints.OutputPoints), Cloud=cullduppoints.OutputPoints)  # -> ClosestPoint, CPIndex, Distance
xy = XYPlane(Origin=cullduppoints.OutputPoints)
item = ListItem(List=cps.Distance, Index=1, Wrap=True)
cir = Circle(Plane=xy, Radius=expr("x/3", item))
